# Grasshopper definition mg.ghx (Grasshopper 1.0.7)

# GRAB ALL AND
# PUT THEM IN !!!
id = Guid([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])
id_2 = Guid([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])
guidtoobject = GhPythonScript(x=id)  # -> a; inputs x: list
# ---------- guidtoobject: Python ----------
from ghpythonlib.componentbase import executingcomponent as component
import Grasshopper, GhPython
import System
import Rhino
import rhinoscriptsyntax as rs
doc = Rhino.RhinoDoc.ActiveDoc

class MyComponent(component):
    
    def RunScript(self, x):
        """Provides a scripting component.
            Inputs:
                x: The x script variable
                y: The y script variable
            Output:
                a: The a output variable"""
        
        __author__ = "Huzt"
        __version__ = "2023.02.23"
        
        import rhinoscriptsyntax as rs
        
        a = []
        print(x)
        
        for i in range(len(x)):
            obj = doc.Objects.Find(x[i])
            obj.Select(True)   
            a.append(obj)
        
        # return outputs if you have them; here I try it for you:
        return a
# ---------- end guidtoobject ----------
guidtoobject_2 = GhPythonScript(x=id_2)  # -> a; inputs x: list; same code as guidtoobject

# ---- group: Use numpy, click to open and run
massing_builder = PythonScript(x=guidtoobject)  # -> a; inputs x: list, y: list
# ---------- massing_builder: Python ----------
from ghpythonlib.componentbase import executingcomponent as component
import Grasshopper, GhPython
import System
import Rhino
import scriptcontext as sc
import Rhino.Geometry as rg
import rhinoscriptsyntax as rs
import Rhino.DocObjects as rd
doc = Rhino.RhinoDoc.ActiveDoc


construction = sc.sticky["construction"] 
helper = sc.sticky["helper"] 
curveTextMatch = sc.sticky["curveTextMatch"] 
BuildingGraph = sc.sticky["BuildingGraph"]
    
class MyComponent(component):
    
    def RunScript(self, x, y):


    
        class Build():                   
                                             
            def __init__(self, curveObject, height, base_height, st):
                self.curve = curveObject.Geometry
                self.height = height
                self.base_height = base_height
                self.st = st
                self.top = st*height+base_height
                self.building = self.buildWhole()
                
            
            def buildWhole(self):
                building = []
                for i in range(self.st):
                    building.extend(self.buildStorey(i))
                return building
             
            def buildStorey(self, i):
                z_v = rg.Transform.Translation(rg.Vector3d(0,0,i*self.height+self.base_height))
                wall = self.buildWall()
                floor =self.buildFloor()
                wall.Transform(z_v)
                floor.Transform(z_v)
                return [wall,floor]
                                        
            def buildWall(self):
                return rg.Extrusion.Create(self.curve,self.height,False)
                
            def buildFloor(self):
                return rg.Brep.CreatePlanarBreps(self.curve)[0]                
        class filterObjects():
            def __init__(self, list, curveList, textList):
                self.list = list
                self.curveList = curveList
                self.textList = textList
            
            def getList(self):
                for i in range(len(self.list)):
                    # isCurve
                    if self.list[i].ObjectType== Rhino.DocObjects.ObjectType.Curve:
                        self.curveList.append(self.list[i])
                    # isAnnotation
                    elif self.list[i].ObjectType == Rhino.DocObjects.ObjectType.Annotation:
                        self.textList.append(self.list[i])

                  
        # GET curveObjects, textObjects
        curveObjects = []
        textObjects = []        
        filter = filterObjects(x,curveObjects,textObjects)
        filter.getList()
        
        # GET match_dict
        CTMatch= curveTextMatch(curveObjects,textObjects)
        match_dict = CTMatch.curveTextDict
        sortedCurveObjects = CTMatch.sortedCurveObjects
        
        # BUILD graph
        G = BuildingGraph(sortedCurveObjects)
        graph = G.Graph
        roots = G.roots
        G.printRoots(match_dict)
        G.printGraphWithTextDict(match_dict)
# ---------- end massing_builder ----------
panel = Panel(massing_builder)

# ----
python = GhPythonScript(x=guidtoobject_2)  # -> a; inputs x: list
# ---------- python: Python ----------
from ghpythonlib.componentbase import executingcomponent as component
import Grasshopper, GhPython
import System
import Rhino
import scriptcontext as sc
import Rhino.Geometry as rg
import rhinoscriptsyntax as rs
import Rhino.DocObjects as rd
doc = Rhino.RhinoDoc.ActiveDoc


construction = sc.sticky["construction"] 
helper = sc.sticky["helper"] 
curveTextMatch = sc.sticky["curveTextMatch"] 
BuildingGraph = sc.sticky["BuildingGraph"] 
    
class MyComponent2(component):
    
    def RunScript(self, x, y):


    
        class Build():                   
                                             
            def __init__(self, curveObject, height, base_height, st):
                self.curve = curveObject.Geometry
                self.height = height
                self.base_height = base_height
                self.st = st
                self.top = st*height+base_height
                self.building = self.buildWhole()
                
            
            def buildWhole(self):
                building = []
                for i in range(self.st):
                    building.extend(self.buildStorey(i))
                return building
             
            def buildStorey(self, i):
                z_v = rg.Transform.Translation(rg.Vector3d(0,0,i*self.height+self.base_height))
                wall = self.buildWall()
                floor =self.buildFloor()
                wall.Transform(z_v)
                floor.Transform(z_v)
                return [wall,floor]
                                        
            def buildWall(self):
                return rg.Extrusion.Create(self.curve,self.height,False)
                
            def buildFloor(self):
                return rg.Brep.CreatePlanarBreps(self.curve)[0]                
        class filterObjects():
            def __init__(self, list, curveList, textList):
                self.list = list
                self.curveList = curveList
                self.textList = textList
            
            def getList(self):
                for i in range(len(self.list)):
                    # isCurve
                    if self.list[i].ObjectType== Rhino.DocObjects.ObjectType.Curve:
                        self.curveList.append(self.list[i])
                    # isAnnotation
                    elif self.list[i].ObjectType == Rhino.DocObjects.ObjectType.Annotation:
                        self.textList.append(self.list[i])

                  
        # GET curveObjects, textObjects
        curveObjects = []
        textObjects = []        
        filter = filterObjects(x,curveObjects,textObjects)
        filter.getList()
        
        isContained = helper.doesContain(curveObjects[0],curveObjects[1])
        
        # GET match_dict
        CTMatch= curveTextMatch(curveObjects,textObjects)
        match_dict = CTMatch.curveTextDict
        
        sortedCurveObjects = CTMatch.sortedCurveObjects

        
        G = BuildingGraph(sortedCurveObjects)
#        print(G)
#        print(match_dict)
        G.printGraphWithTextDict(match_dict)
# ---------- end python ----------
graph = GhPythonScript()
# ---------- graph: Python ----------
import scriptcontext as sc
import Rhino.Geometry as rg
import rhinoscriptsyntax as rs
import Rhino.DocObjects as rd
helper = sc.sticky["helper"] 



class BuildingGraph:
    `"""
     input : sortedCurveObjects(length increment)
     output: dictionary representing graph, root node(base curve)
    """`
    def __init__(self,sortedCurveObjects):
        self.sortedCurveObjects = sortedCurveObjects
        # reverse to decrement
        self.sortedCurveObjects.reverse()
        self.Graph = {}
        self.roots = []
        self.buildGraph()
        self.getRoots()
        
    def addNode(self,curveObject):
        if not (curveObject in self.Graph):
            self.Graph[curveObject] =[]
       
    def addChild(self,curveObject1,curveObject2):
        self.Graph[curveObject1].append(curveObject2)
     
    def buildGraph(self):
        l = len(self.sortedCurveObjects)
        for i in range(l):
            parent = self.sortedCurveObjects[i]
            if not(parent in self.Graph):
                self.addNode(parent)
            # Safely assume there is no child which has larger foot print than parent
            for j in range(i+1,l):
                child = self.sortedCurveObjects[j]
                if  helper.isChild(parent,child,self.sortedCurveObjects):
                    self.addChild(parent,child)
    
    def getRoots(self):
       `"""
       return an array of root
       """`
       seen = set()
       for crv in self.Graph:
           values = self.Graph[crv]
           for j in range(len(values)):
               seen.add(values[j])
               
       for crv in self.Graph:
           if not(crv in seen):
               self.roots.append(crv)
       
    #DEBUG ONLY
    def printGraphWithTextDict(self,match_dict):
        for crv in self.Graph:
            print(crv.Geometry.GetLength(),":")
            print("Text Notation is:",match_dict[crv].Geometry.Text)
            values = self.Graph[crv]
            for i in range(len(values)):
                print("  ",values[i].Geometry.GetLength())
            print("\n")

    #DEBUG ONLY
    def printRoots(self,match_dict):
        for crv in self.roots:
            print("Root: ",crv.Geometry.GetLength())
            print("Text Notation is:",match_dict[crv].Geometry.Text)
            print("\n")

sc.sticky["BuildingGraph"] = BuildingGraph
# ---------- end graph ----------
curvetextmatch = GhPythonScript()
# ---------- curvetextmatch: Python ----------
import scriptcontext as sc
import Rhino.Geometry as rg
import rhinoscriptsyntax as rs
import Rhino.DocObjects as rd
helper = sc.sticky["helper"] 

# match the text to curve selected
class cuvrveTextMatch:
    
    # input : curveObjects, textObject
    # desired output : dictionary with curve-text matches -> curveTextDict.curveTextDict
    def __init__(self,curveObjects,textObjects):
        self.curveObjects = curveObjects
        self.sortedCurveObjects = self.sortCurveObjects() 
        self.textObjects = textObjects
        self.textList = helper.convertToGeometry(textObjects)
        self.centers = self.getCenters()
        self.curveTextDict = self.getDict()


    def getDict(self):
        `"""`
        Return a dict:
            key : curveObject
            value : textObject
        `"""`

        # initate dict and set
        dict = {}
        seen = set()
        # match text into curve, if the text center is inside curve closure
        for i in range(len(self.sortedCurveObjects)):
            curve = self.sortedCurveObjects[i].Geometry
            # iterate all centers to find if it is inside this curve
            for j in range(len(self.centers)):
                # Create flat plane
                plane = rg.Plane(self.centers[j],rg.Vector3d.ZAxis)
                # Project the curves onto the plane
                curve = rg.Curve.ProjectToPlane(curve, plane)   
                if not(j in seen) and curve.Contains(self.centers[j],plane)== rg.PointContainment.Inside:
                    dict[self.sortedCurveObjects[i]]=self.textObjects[j]
                    seen.add(j)
                    break
        return dict
        
        
    def getCenters(self):
        centers = []
        for i in range(len(self.textList)):
            centers.append(self.textList[i].GetBoundingBox(True).Center)
        return centers
     
    def curveObjectLength(self,crv):
        return crv.Geometry.GetLength() 
    def sortCurveObjects(self):
        return sorted(self.curveObjects,key = self.curveObjectLength) 
    def printMatch(self):
        for curve in self.curveTextDict:
            print("Curve length is:",curve.Geometry.GetLength()," Text is ",self.curveTextDict[curve].Geometry.Text)


sc.sticky["curveTextMatch"] = cuvrveTextMatch
# ---------- end curvetextmatch ----------
construction = GhPythonScript()
# ---------- construction: Python ----------
import scriptcontext as sc

class construction:
    @classmethod
    def __init__(self):
        return None



sc.sticky["construction"] = construction()
# ---------- end construction ----------
helpers = GhPythonScript()
# ---------- helpers: Python ----------
import scriptcontext as sc
import Rhino.Geometry as rg
import rhinoscriptsyntax as rs
import Rhino.DocObjects as rd

class helper:
        
    def convertToGeometry(cls,objectList):
        res = []
        for i in range(len(objectList)):
            res.append(objectList[i].Geometry)
        return res

    def printCurveObjectLength(cls,curveObjects):
        for i in range(len(curveObjects)):
            print(curveObjects[i].Geometry.GetLength())
            
    def doesContain(cls,curveObject1, curveObject2):
        `"""
        Determine if curveObject1 contains curveObject2:
            1. curveObject1 area is larger than curveObject2 area
            2. there has to be more than 80% overlap in between
        """`
        #corner case
        if curveObject1==curveObject2:
            return False
        
        #overlapped ration defined here
        ratio = 0.8
        
        crv1 = curveObject1.Geometry
        crv2 = curveObject2.Geometry
        
        # project curve into same plane
        point = rg.Point3d(0,0,0)
        plane = rg.Plane(point,rg.Vector3d.ZAxis)
        crv1 = rg.Curve.ProjectToPlane(crv1, plane)
        crv2 = rg.Curve.ProjectToPlane(crv2, plane)
        
        # create breps from thsoe two planar curves
        brep1=rg.Brep.CreatePlanarBreps(crv1)[0]
        area1 = brep1.GetArea()
        brep2=rg.Brep.CreatePlanarBreps(crv2)[0]
        area2 = brep2.GetArea()
        
        # if area1< area2 then return False
        if area1<area2:
            return False
        
        # intersec thsoe two surface
        intersect = rg.Intersect.Intersection.BrepBrep(brep1,brep2,0.001)[1]
       
        # if no intersection
        if len(intersect)==0:
            return False
        brep3=rg.Brep.CreatePlanarBreps(intersect[0])[0]
        area3 = brep3.GetArea()
   
        area_small = area1
        if area2<area1:
            area_small=area2
        if area3/area_small<ratio:
            return False
        else:
            return True
      
    def isChild(cls,parent,child,sortedCurveObjects):
        `"""
         only if parent contains child, and no other curveObjects contains child, return true
        """`
        if not(cls.doesContain(parent,child)):
            return False
        
        start = 0
        for i in range(len(sortedCurveObjects)):
            potentialParent = sortedCurveObjects[i]
            if potentialParent == parent:
                start = i+1
                break
#        print("s",start)
        for i in range(start,len(sortedCurveObjects)):
            potentialParent = sortedCurveObjects[i]
            if(cls.doesContain(potentialParent,child)):
                return False     
        return True
        

sc.sticky["helper"] = helper()
# ---------- end helpers ----------
panel_2 = Panel(python)
# Turn me on!   -->
python_2 = PythonScript()  # -> rhino_doc_dir
# ---------- python_2: Python ----------
import scriptcontext as sc
from os import path

rhino_doc_dir = path.abspath(path.dirname(sc.doc.Path))
# ---------- end python_2 ----------
list = ValueList({"CRITICAL", "ERROR", "WARNING", "INFO", "DEBUG", "NOTSET"}, selected="DEBUG")

# ---- group: Import remote python modules
panel_3 = Panel(python_2)
panel_4 = Panel("""numpy
scipy
numpy.linalg""")
# GH to python remote example.
# ⓒ Pierre Cuvilliers, 2017-2022
# Runs and connects to an external python engine, and
# assigns imported modules to scriptcontext.sticky variables.
# 
# Arguments:
#       code (str): Path to the GH_to_python.py code file.
#       location (str): Path to a python executable, or to a folder
#             containing `python.exe`, or the name of a conda-created
#             virtual environment prefixed by `conda://` (`conda://env_name`).
#             If empty, finds python from your windows %PATH%.
#       run (boolean): Creates the connection, and imports new
#             modules, when turned to True. Kills the connection,
#             and deletes the references to the imports, when turned
#             to False.
#       modules (str list): List of module names to import in the
#             remote python. They will be added to the
#             scriptcontext.sticky dictionary, allowing them to be
#             reused from other python components in the same
#             Grasshopper document. Submodules (for example
#             `numpy.linalg`) have to be added explicitly to this list
#             to be available later, and importing the parent package is
#             also required even if only the submodule is used.
#       log_level (str from ['NOTSET', 'DEBUG', 'INFO', 'WARNING', 'ERROR', 'CRITICAL']):
#             Logging level to use for the local IronPython and the
#             remote python instance.
#       working_dir (str): Working directory for the remote python
#             instance.
# 
# Returns:
#       out (str): Console output with DEBUG information.
#       linked_modules (str list): list of imported module names.
#       rpy (rpyc connection object): The object representing the remote Python interpreter.
# Released under the MIT license
# github.com/pilcru/ghpythonremote
panel_5 = Panel("conda://rhinoremote")
ghpythonremote = GHPythonRemote(location=panel_5, run=Toggle(False), modules=panel_4, log_level=list, working_dir=panel_3)  # -> out, linked_modules, rpy; inputs run: Boolean, modules: list
# ---------- ghpythonremote: Python ----------
import inspect
import logging
from os import path
import sys
from time import sleep

import scriptcontext

import ghpythonremote
from ghpythonremote.connectors import GrasshopperToPythonRemote
from Grasshopper.Kernel.GH_RuntimeMessageLevel import Error, Warning

local_log_level = getattr(logging, log_level, logging.WARNING)
logger = logging.getLogger("ghpythonremote")
logger.setLevel(local_log_level)
ch = logging.StreamHandler()
ch.setLevel(local_log_level)
formatter = logging.Formatter("%(levelname)s: %(name)s:\n%(message)s")
ch.setFormatter(formatter)
logger.handlers = []
logger.addHandler(ch)
logger = logging.getLogger("ghpythonremote.GH_to_python")

ROOT = path.abspath(path.dirname(inspect.getfile(ghpythonremote)))
rpyc_server_py = path.join(ROOT, "pythonservice.py")

cluster_comp = ghenv.Component.OnPingDocument().Owner

# Set connection to CLOSED if this is the first run
# and initialize set of linked modules
try:
    remote_python_status
except NameError:
    remote_python_status = "CLOSED"
    lkd_modules = set()

# Wait for connection to connect or terminate
timer = 0
while remote_python_status == "CONNECTING" or remote_python_status == "CLOSING":
    sleep(1)
    timer += 1
    if timer == 10:
        try:
            gh2py_manager.__exit__(*sys.exc_info())
        except Exception:
            pass
        remote_python_status = "CLOSED"
        lkd_modules = set()
        message = (
            "Connection left in an inconsistent state and not returning. Reset "
            "everything."
        )
        if cluster_comp is not None:
            cluster_comp.AddRuntimeMessage(Warning, message)
        raise RuntimeError(message)

if run:
    if not remote_python_status == "OPEN":
        remote_python_status = "CONNECTING"
        gh2py_manager = GrasshopperToPythonRemote(
            rpyc_server_py,
            location=location,
            timeout=10,
            port=None,
            log_level=log_level,
            working_dir=working_dir,
        )
        gh2py = gh2py_manager.__enter__()
        remote_python_status = "OPEN"

    # Stuff that we can reach
    rpymod = gh2py.py_remote_modules  # A getter function for a named python module
    rpy = gh2py.connection  # Represents the remote instance root object
    scriptcontext.sticky["rpy"] = rpy
    # Add modules
    for mod in modules:
        try:
            scriptcontext.sticky[mod] = rpymod(mod)
            lkd_modules.add(mod)
        except ImportError:
            gh2py_manager.__exit__(*sys.exc_info())
            if cluster_comp is not None:
                cluster_comp.AddRuntimeMessage(
                    Error,
                    'Could not import module "{}" in remote Python.'.format(mod)
                )
            raise
        except EOFError:
            if cluster_comp is not None:
                cluster_comp.AddRuntimeMessage(
                    Error,
                    'Remote Python has been closed unexpectedly'
                )
            raise

elif not remote_python_status == "CLOSED":
    remote_python_status = "CLOSING"
    # Remove linked modules
    for mod in lkd_modules:
        del scriptcontext.sticky[mod]
    del scriptcontext.sticky["rpy"]
    gh2py_manager.__exit__(*sys.exc_info())
    lkd_modules = set()
    remote_python_status = "CLOSED"

# Change variable name because ghpython resets outputs to None before each run
linked_modules = lkd_modules

logger.info("GH to python connection is {}".format(remote_python_status))
# ---------- end ghpythonremote ----------
panel_6 = Panel(ghpythonremote.out)

# ----
python_3 = PythonScript(module_names=ghpythonremote.linked_modules)  # -> import_statements; inputs module_names: list
# ---------- python_3: Python ----------
import_statements = ["import scriptcontext as sc"]
for module_name in module_names:
    import_statements.append("{0} = sc.sticky['{0}']".format(module_name))

if len(module_names) == 0:
    import_statements = []
# ---------- end python_3 ----------
panel_7 = Panel(python_3)
