# Grasshopper definition mg2.ghx (Grasshopper 1.0.7)

# GRAB ALL AND
# PUT THEM IN !!!
id = Guid([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])
id_2 = Guid(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)
guidtoobject = GhPythonScript(x=id_2)  # -> a; inputs x: list
# ---------- guidtoobject: Python ----------
from ghpythonlib.componentbase import executingcomponent as component
import Grasshopper, GhPython
import System
import Rhino
import rhinoscriptsyntax as rs
doc = Rhino.RhinoDoc.ActiveDoc

class MyComponent(component):
    
    def RunScript(self, x):
        """Provides a scripting component.
            Inputs:
                x: The x script variable
                y: The y script variable
            Output:
                a: The a output variable"""
        
        __author__ = "Huzt"
        __version__ = "2023.02.23"
        
        import rhinoscriptsyntax as rs
        
        a = []
        print(x)
        
        for i in range(len(x)):
            obj = doc.Objects.Find(x[i])
            obj.Select(True)   
            a.append(obj)
        
        # return outputs if you have them; here I try it for you:
        return a
# ---------- end guidtoobject ----------
python = GhPythonScript(x=guidtoobject)  # -> a; inputs x: list
# ---------- python: Python ----------
from ghpythonlib.componentbase import executingcomponent as component
import Grasshopper, GhPython
import System
import Rhino
import scriptcontext as sc
import Rhino.Geometry as rg
import rhinoscriptsyntax as rs
import Rhino.DocObjects as rd
doc = Rhino.RhinoDoc.ActiveDoc
construction = sc.sticky["construction"] 
helper = sc.sticky["helper"] 
curveTextMatch = sc.sticky["curveTextMatch"] 
BuildingGraph = sc.sticky["BuildingGraph"]
BuildBuilding = sc.sticky["BuildBuilding"]




class MyComponent(component):

    def RunScript(self, x, y):
          
        class filterObjects():
            def __init__(self, list, curveList, textList):
                self.list = list
                self.curveList = curveList
                self.textList = textList
            
            def getList(self):
                for i in range(len(self.list)):
                    # isCurve
                    if self.list[i].ObjectType== Rhino.DocObjects.ObjectType.Curve:
                        self.curveList.append(self.list[i])
                    # isAnnotation
                    elif self.list[i].ObjectType == Rhino.DocObjects.ObjectType.Annotation:
                        self.textList.append(self.list[i])  
  # GET curveObjects, textObjects
        curveObjects = []
        textObjects = []        
        filter = filterObjects(x,curveObjects,textObjects)
        filter.getList()
        
        crv = curveObjects[0].Geometry
        print(crv)
        pl = helper.curveReconstruct(crv)
        print(pl)
        return pl
# ---------- end python ----------
preview = CustomPreview(Geometry=python, Material=ColourSwatch(SwatchColor=RGB(255, 43, 43)))
guidtoobject_2 = GhPythonScript(x=id)  # -> a; inputs x: list; same code as guidtoobject
panel = Panel(guidtoobject_2)

# ---- group: Use numpy, click to open and run
massing_builder = PythonScript(x=guidtoobject_2)  # -> a; inputs x: list, y: list
# ---------- massing_builder: Python ----------
from ghpythonlib.componentbase import executingcomponent as component
import Grasshopper, GhPython
import System
import Rhino
import scriptcontext as sc
import Rhino.Geometry as rg
import rhinoscriptsyntax as rs
import Rhino.DocObjects as rd
import ghpythonlib.components as ghcomp

doc = Rhino.RhinoDoc.ActiveDoc


construction = sc.sticky["construction"] 
helper = sc.sticky["helper"] 
curveTextMatch = sc.sticky["curveTextMatch"] 
BuildingGraph = sc.sticky["BuildingGraph"]
BuildBuilding = sc.sticky["BuildBuilding"]







    
class MyComponent(component):


    def RunScript(self, x, y):
        
        def addRhinoDocEvent(self,sender, e):
            # Update the GH component
            print("called")
            self.ExpireSolution(True)
     
        # Check if the event handler is already assigned
        if "eventID" not in globals():
            # Assign the handler function to a Rhino event
            eventID = Rhino.RhinoDoc.AddRhinoObject
            eventID += addRhinoDocEvent
            
        class filterObjects():
            def __init__(self, list, curveList, textList):
                self.list = list
                self.curveList = curveList
                self.textList = textList
            
            def getList(self):
                for i in range(len(self.list)):
                    # isCurve
                    if self.list[i].ObjectType== Rhino.DocObjects.ObjectType.Curve:
                        self.curveList.append(self.list[i])
                    # isAnnotation
                    elif self.list[i].ObjectType == Rhino.DocObjects.ObjectType.Annotation:
                        self.textList.append(self.list[i])

                  
        # GET curveObjects, textObjects
        curveObjects = []
        textObjects = []        
        filter = filterObjects(x,curveObjects,textObjects)
        filter.getList()
        
        # GET match_dict
        CTMatch= curveTextMatch(curveObjects,textObjects)
        match_dict = CTMatch.curveTextDict
        sortedCurveObjects = CTMatch.sortedCurveObjects
        
        
        # BUILD graph
        G = BuildingGraph(sortedCurveObjects)
        graph = G.Graph
        roots = G.roots
#        G.printRoots(match_dict)
#        G.printGraphWithTextDict(match_dict)
        
        # BUILD building
        build = BuildBuilding(roots,graph,match_dict)
        return build.building
# ---------- end massing_builder ----------

# ----
preview_2 = CustomPreview(
    Geometry=massing_builder,
    Material={diffuse=RGB(221, 160, 221), emission=RGB(66, 48, 66), shine=0.5, specular=RGB(255, 255, 255), transparency=0})
buildbuilding = GhPythonScript()
# ---------- buildbuilding: Python ----------
import scriptcontext as sc
import Rhino.Geometry as rg
import rhinoscriptsyntax as rs
import Rhino.DocObjects as rd
helper = sc.sticky["helper"] 


class BuildEach():                   
                                     
    def __init__(self, curveObject, program, base_height, st, special):
        self.curve = helper.curveReconstruct(curveObject.Geometry)
        
        # determine the height based on program
        if(program.lower() == "retail"):
            self.height = 4000
        elif(program.lower()=="office"):
            self.height = 4000
        else:
            self.height = 3000
        
        self.base_height = base_height
        self.st = st
        self.top = st*self.height+base_height
        self.buildEach = self.buildEach()
        
        # FUTURE REVISION,MIGHT USE OVERLOAD!
        self.special = special
        
    
    def buildEach(self):
        building = []
        # build typical floor
        for i in range(self.st):
            building.extend(self.buildStorey(i))
            
        # build top slab
        z_v = rg.Transform.Translation(rg.Vector3d(0,0,self.st*self.height+self.base_height))
        top_slab = self.buildFloor()
        top_slab.Transform(z_v)
        building.append(top_slab)
        return building
     
    def buildStorey(self, i):
        z_v = rg.Transform.Translation(rg.Vector3d(0,0,i*self.height+self.base_height))
        wall = self.buildWall()
        floor =self.buildFloor()
        wall.Transform(z_v)
        floor.Transform(z_v)
        return [wall,floor]
                                
    def buildWall(self):
        vector = rg.Vector3d(0,0,self.height)
        return rg.Extrusion.CreateExtrusion(self.curve,vector)
        
    def buildFloor(self):
        return rg.Brep.CreatePlanarBreps(self.curve)[0]

class BuildBuilding():
    `"""
     input : roots as building bases(>=1), graph
     output: building mass
    """`
    def __init__(self,roots,graph,match_dict):
        self.roots= roots
        self.graph = graph
        self.match_dict = match_dict
        self.building = []
        self.buildWhole()
    
    def buildWhole(self):
        for i in range(len(self.roots)):
            self.building.extend(self.buildBlock(self.roots[i]))
            
    def buildBlock(self,root):
        Block = []
        st, program = helper.flagFinder(self.match_dict[root].Geometry.Text)
        if(st == None):
            helper.promptWarning("Need storey number input!")
            return
        ##NEEDED TO BE REVISED IN FUTURE
        build = BuildEach(root,program,0,st,"base")
        Block.extend(build.buildEach)
        ##NEEDED TO BE REVISED IN FUTURE
        
        # Recursive construct
        built = set()
        built.add(root)
        self.dfsConstruct(Block,root,build.top,built)
        
        return Block
   
    def dfsConstruct(self,Block,parent,base_height,built):
       children = self.graph[parent]
       for child in children:
           if child in built:
               continue
           # build 
           built.add(child)
           st, program = helper.flagFinder(self.match_dict[child].Geometry.Text)
           if(st == None):
               helper.promptWarning("Need storey number input!")
               return
           build = BuildEach(child,program,base_height,st,None)
           Block.extend(build.buildEach)
           self.dfsConstruct(Block,child,build.top,built)

sc.sticky["BuildBuilding"] = BuildBuilding
# ---------- end buildbuilding ----------
graph = GhPythonScript()
# ---------- graph: Python ----------
import scriptcontext as sc
import Rhino.Geometry as rg
import rhinoscriptsyntax as rs
import Rhino.DocObjects as rd
helper = sc.sticky["helper"] 



class BuildingGraph:
    `"""
     input : sortedCurveObjects(length increment)
     output: dictionary representing graph, root node(base curve)
    """`
    def __init__(self,sortedCurveObjects):
        self.sortedCurveObjects = sortedCurveObjects
        # reverse to decrement
        self.sortedCurveObjects.reverse()
        self.Graph = {}
        self.roots = []
        self.buildGraph()
        self.getRoots()
        
    def addNode(self,curveObject):
        if not (curveObject in self.Graph):
            self.Graph[curveObject] =[]
       
    def addChild(self,curveObject1,curveObject2):
        self.Graph[curveObject1].append(curveObject2)
     
    def buildGraph(self):
        l = len(self.sortedCurveObjects)
        for i in range(l):
            parent = self.sortedCurveObjects[i]
            if not(parent in self.Graph):
                self.addNode(parent)
            # Safely assume there is no child which has larger foot print than parent
            for j in range(i+1,l):
                child = self.sortedCurveObjects[j]
                if  helper.isChild(parent,child,self.sortedCurveObjects):
                    self.addChild(parent,child)
    
    def getRoots(self):
       `"""
       return an array of root
       """`
       seen = set()
       for crv in self.Graph:
           values = self.Graph[crv]
           for j in range(len(values)):
               seen.add(values[j])
               
       for crv in self.Graph:
           if not(crv in seen):
               self.roots.append(crv)
       
    #DEBUG ONLY
    def printGraphWithTextDict(self,match_dict):
        for crv in self.Graph:
            print(crv.Geometry.GetLength(),":")
            print("Text Notation is:",match_dict[crv].Geometry.Text)
            values = self.Graph[crv]
            for i in range(len(values)):
                print("  ",values[i].Geometry.GetLength())
            print("\n")

    #DEBUG ONLY
    def printRoots(self,match_dict):
        for crv in self.roots:
            print("Root: ",crv.Geometry.GetLength())
            print("Text Notation is:",match_dict[crv].Geometry.Text)
            print("\n")

sc.sticky["BuildingGraph"] = BuildingGraph
# ---------- end graph ----------
curvetextmatch = GhPythonScript()
# ---------- curvetextmatch: Python ----------
import scriptcontext as sc
import Rhino.Geometry as rg
import rhinoscriptsyntax as rs
import Rhino.DocObjects as rd
helper = sc.sticky["helper"] 

# match the text to curve selected
class cuvrveTextMatch:
    
    # input : curveObjects, textObject
    # desired output : dictionary with curve-text matches -> curveTextDict.curveTextDict
    def __init__(self,curveObjects,textObjects):
        self.curveObjects = curveObjects
        self.sortedCurveObjects = self.sortCurveObjects() 
        self.textObjects = textObjects
        self.textList = helper.convertToGeometry(textObjects)
        self.centers = self.getCenters()
        self.curveTextDict = self.getDict()


    def getDict(self):
        `"""`
        Return a dict:
            key : curveObject
            value : textObject
        `"""`

        # initate dict and set
        dict = {}
        seen = set()
        # match text into curve, if the text center is inside curve closure
        for i in range(len(self.sortedCurveObjects)):
            curve = helper.curveReconstruct(self.sortedCurveObjects[i].Geometry)
            # iterate all centers to find if it is inside this curve
            for j in range(len(self.centers)):
                # Create flat plane
                plane = rg.Plane(self.centers[j],rg.Vector3d.ZAxis)
                # Project the curves onto the plane
                curve = rg.Curve.ProjectToPlane(curve, plane)   
                if not(j in seen) and curve.Contains(self.centers[j],plane)== rg.PointContainment.Inside:
                    dict[self.sortedCurveObjects[i]]=self.textObjects[j]
                    seen.add(j)
                    break
        return dict
        
        
    def getCenters(self):
        centers = []
        for i in range(len(self.textList)):
            centers.append(self.textList[i].GetBoundingBox(True).Center)
        return centers
     
    def curveObjectLength(self,crv):
        return crv.Geometry.GetLength() 
    def sortCurveObjects(self):
        return sorted(self.curveObjects,key = self.curveObjectLength) 
    def printMatch(self):
        for curve in self.curveTextDict:
            print("Curve length is:",curve.Geometry.GetLength()," Text is ",self.curveTextDict[curve].Geometry.Text)


sc.sticky["curveTextMatch"] = cuvrveTextMatch
# ---------- end curvetextmatch ----------
construction = GhPythonScript()
# ---------- construction: Python ----------
import scriptcontext as sc

class construction:
    @classmethod
    def __init__(self):
        return None



sc.sticky["construction"] = construction()
# ---------- end construction ----------
helpers = GhPythonScript()
# ---------- helpers: Python ----------
import scriptcontext as sc
import Rhino.Geometry as rg
import rhinoscriptsyntax as rs
import Rhino.DocObjects as rd
import re

class helper:
        
    ### BASIC HELPER FUNCTION
    def convertToGeometry(cls,objectList):
        res = []
        for i in range(len(objectList)):
            res.append(objectList[i].Geometry)
        return res
      
    ### CURVE PROCESS  
    def convertPolyline(cls,curve):
        if(curve.TryGetPolyline()[0]):
            return curve.TryGetPolyline()[1]
        else:
            polyline_curve = curve.ToPolyline(0.1,False,False,False)     
            return polyline_curve.ToPolyline()

    def printCurveObjectLength(cls,curveObjects):
        for i in range(len(curveObjects)):
            print(curveObjects[i].Geometry.GetLength())
    
    def curveReconstruct(cls,crv):
        `"""
        input: curves of any type(polycurves,nurbscurves...)
        output: projectd nurbscurve 
        
        step1: convert to polyline
        step2: close polyline
        step3: convert to Nurbs
        
        """`
        polyline = cls.convertPolyline(crv)
        segments = polyline.GetSegments()
#        # Create a list of points from the line segments
#        points = []
#        for segment in segments:
#            points.append(segment.From)
#        points.append(segments[-1].To)
#        # Create a list of points from the line segments
#        points = []
#        for segment in segments:
#            points.append(segment.From)
#        points.append(segments[-1].To)
#        # Create a new PolylineCurve object from the concatenated points
#        polyline = rg.Polyline(points)
        # Close polyline 
        cls.closePolylines(polyline)
       # Convert the PolylineCurve to a Polyline
        return polyline.ToNurbsCurve()
        
    def closePolylines(cls,polyline):
        is_closed = polyline[0].DistanceTo(polyline[len(polyline)-1]) < 1e-6
        # Close the Polyline if it is not closed
        if not is_closed:
            polyline.Add(polyline[0])    
        
    def mergeCurves(cls,crv1,crv2):
        `"""
        Inpute: curve gemoetry
        convert curves of different types to polylines, then extract the points, and generate polylines, then convert to polylincruve as final steps
        """`
        polyline_1 = cls.convertPolyline(crv1)
        polyline_2 = cls.convertPolyline(crv2)
        # Get the line segments of each polyline
        segments_1 = polyline_1.GetSegments()
        segments_2 = polyline_2.GetSegments()
        
        # Create a list of points from the line segments
        points = []
        for segment in segments_1:
            points.append(segment.From)
        points.append(segments_1[-1].To)
        for segment in segments_2:
            points.append(segment.From)
        points.append(segments_2[-1].To)
        
        # Create a new PolylineCurve object from the concatenated points
        polyline = rg.Polyline(points)
        # Close polyline 
        cls.closePolylines(polyline)
       # Convert the PolylineCurve to a Polyline
        crv = polyline.ToNurbsCurve()
        # Project crv to ground 0
        point = rg.Point3d(0,0,0)
        plane = rg.Plane(point,rg.Vector3d.ZAxis)
        crv = rg.Curve.ProjectToPlane(crv, plane)
        return crv
        
                

    
    
    ### DETERMINE CURVE OBJECT RELATIONSHIP  
    def doesContain(cls,curveObject1, curveObject2):
        `"""
        Determine if curveObject1 contains curveObject2:
            1. curveObject1 area is larger than curveObject2 area
            2. there has to be more than 80% overlap in between
        """`
        #corner case

        if curveObject1==curveObject2:
            return False
        
        #overlapped ration defined here
        ratio = 0.8
        
        crv1 = curveObject1.Geometry
        crv2 = curveObject2.Geometry
        
        # project curve into same plane
        point = rg.Point3d(0,0,0)
        plane = rg.Plane(point,rg.Vector3d.ZAxis)
        crv1 = rg.Curve.ProjectToPlane(crv1, plane)
        crv2 = rg.Curve.ProjectToPlane(crv2, plane)
        
        # create breps from thsoe two planar curves
        brep1=rg.Brep.CreatePlanarBreps(crv1)[0]
        area1 = brep1.GetArea()
        brep2=rg.Brep.CreatePlanarBreps(crv2)[0]
        area2 = brep2.GetArea()

        # if area1< area2 then return False
        if area1<area2:
            return False
        
        # intersec thsoe two surface
        intersect = rg.Intersect.Intersection.BrepBrep(brep1,brep2,0.001)[1]
        
 
        # if no intersection
        if len(intersect)==0:
            return False
            
        crv = intersect[0]
        
        # merge intersect into crv if lentgh > 1
        if(len(intersect)>1):
            for i in range(1,len(intersect)):
                crv = cls.mergeCurves(crv,intersect[i])
        
        # create brep3 by crv as intersected brep
        brep3=rg.Brep.CreatePlanarBreps(crv)[0]
        area3 = brep3.GetArea()
   
        area_small = area1
        if area2<area1:
            area_small=area2
        if area3/area_small<ratio:
            return False
        else:
            return True
      
    def isChild(cls,parent,child,sortedCurveObjects):
        `"""
         only if parent contains child, and no other curveObjects contains child, return true
        """`
        if not(cls.doesContain(parent,child)):
            return False
        
        start = 0
        for i in range(len(sortedCurveObjects)):
            potentialParent = sortedCurveObjects[i]
            if potentialParent == parent:
                start = i+1
                break
        for i in range(start,len(sortedCurveObjects)):
            potentialParent = sortedCurveObjects[i]
            if(cls.doesContain(potentialParent,child)):
                return False     
        return True
        
    ### STRING PROCESSING
    def flagFinder(cls,str):
        st = re.search(r'\d+', str)
        res = re.search(r'res', str)
        retail = re.search(r'retail', str)
        office = re.search(r'office', str)
        
        if retail:
            program = retail.group()
        elif office:
            program = office.group()
        else:
            program = "res"           
            
        if not st:
            return None
        else:
             return(int(st.group()),program)           

    ### UI
    def promptWarning(cls,str):
        str = rs.MessageBox(message)

sc.sticky["helper"] = helper()
# ---------- end helpers ----------
